# Grasshopper definition Comma Centre.ghx (Grasshopper 1.0.7)

knob = ControlKnob(Decimals=0, Limit=True, Maximum=99, Minimum=0, Range=10, Value=0)
list = ValueList({"ALPHA": "ALPHA.a.", "Beta": "Beta.0.", "Stable": " "}, selected="ALPHA")
ver = VersionCreate(P="「Comma Centre」", D=[list, Slider(1, range=1..9)], V=Slider(0, range=0..9), D_2=knob)
panel = Panel(ver)

number_slider = Slider(797, range=0..1000)
X = UnitX(Factor=expr("-x", 1))
pt = ConstructPoint(XCoordinate=0, YCoordinate=0, ZCoordinate=0)
line = LineSDL(Start=pt, Direction=X, Length=number_slider)
rectangle = Rectangle(Plane=PlaneXY(0, 0, 0), XSize=Domain(-1, 1), YSize=Domain(-2, 2), Radius=0)  # -> Rectangle, Length
boundary = BoundarySurfaces(Edges=rectangle.Rectangle)
division = Division(A=number_slider, B=Slider(4, range=2..8))
flip = Flip(Surface=boundary)  # -> Surface, Result
textsrf = TextOnSurface(
    Text=panel,
    Font="Futura Bold:no Italic:no",
    Height=division,
    Depth=Slider(19, range=0..50),
    BaseLine=line,
    BaseSurface=flip.Surface)
yz = YZPlane(Origin=Point(0, 0, 0))
xy = XYPlane(Origin=Point(0, 0, 0))
X_2 = UnitX(Factor=1)
mirror = Mirror(Geometry=textsrf, Plane=yz)  # -> Geometry, Transform
rad = Radians(Degrees=Slider(23.3, range=0..90))
line_2 = LineSDL(Start=xy, Direction=X_2, Length=1)
rotax = RotateAxis(Geometry=mirror.Geometry, Angle=rad, Axis=line_2)  # -> Geometry, Transform
material = CreateMaterial(
    Diffuse=ColourSwatch(SwatchColor=RGB(255, 254, 254)),
    Specular=RGB(255, 254, 254),
    Emission=RGB(0, 0, 0),
    Transparency=0,
    Shine=0)
preview = CustomPreview(Geometry=rotax.Geometry, Material=material)

# ==== cluster VersionCreate: 自动更新
D = ClusterInput()  # type
bang = ExplodeTree(Data=graft(D))  # -> Branch0, Branch1
T = Text(bang.Branch0)
entwine = Entwine(Branch00=bang.Branch1, Branch01=".", FlattenInputs=True)  # -> flatten(Result)
tmatch = MatchText(Text=T, Pattern=" ", Case=True)
join = TextJoin(Text=entwine)
P = ClusterInput()
p_n_c = PickNChoose(Pattern=tmatch, Stream0=T, Stream1=join)
D_2 = ClusterInput()
V = ClusterInput()
P_2 = Text(P)
V_2 = Integer(V)
D_3 = Integer(D_2)
entwine_2 = Entwine(Branch00=P_2, Branch02="Ver-", Branch03=p_n_c, Branch04=V_2, Branch05=".", Branch06=D_3, FlattenInputs=True)  # -> flatten(Result)
join_2 = TextJoin(Text=entwine_2)
R = ClusterOutput(join_2)
